# Grasshopper definition morph.gh (Grasshopper 0.9.76)

surface = Surface(<surface referenced from the Rhino model>)
surface_2 = Surface(<surface referenced from the Rhino model>)
surface_3 = Surface(<surface referenced from the Rhino model>)
brep = Brep(<brep referenced from the Rhino model>)
brep_2 = Brep(<brep referenced from the Rhino model>)
brep_3 = Brep(<brep referenced from the Rhino model>)
surface_4 = Surface(surface)
surface_5 = Surface([<surface referenced from the Rhino model> x6])
merge = Merge(Data1=surface, Data2=surface_2, Data3=surface_3, Data4=brep, Data5=brep_3, Data6=brep_2)
list_item = ListItem(List=merge, Index=Slider(5, range=0..6), Wrap=True)
mesh_plane = MeshPlane(Boundary=surface_4, WidthCount=11, HeightCount=20)  # -> Mesh, Area
brep_4 = Brep(list_item)
