# Grasshopper definition wind3.gh (Grasshopper 1.0.4)

point = Point(<point referenced from the Rhino model>)
number = Number(1)
cluster = Cluster(point=point, degrees=Slider(219.6, range=0..360))  # -> point_3, geometry
mesh_box = MeshBox(
    Base={Plane=PlaneXY(0, 0, 0), X=Domain(-10, 10), Y=Domain(-10, 10), Z=Domain(-10, 10)},
    XCount=number,
    YCount=number,
    ZCount=number)
vector_display = VectorDisplay(Anchor=cluster.point_3, Vector=cluster.geometry)

# ==== cluster Cluster
degrees = ClusterInput()
point = ClusterInput()
unit_y = UnitY(Factor=1)
radians = Radians(Degrees=degrees)
rotate = Rotate(Geometry=unit_y, Angle=radians, Plane=PlaneXY(0, 0, 0))  # -> Geometry, Transform
geometry = ClusterOutput(rotate.Geometry)
point_2 = Point(point)
point_3 = ClusterOutput(point_2)
