# Grasshopper definition wind_rh5.gh (Grasshopper 0.9.76)
# plug-ins: Python Interpreter

level = Slider(5, range=0..60)
mesh = Mesh([<mesh referenced from the Rhino model> x11])
brep = Brep([<brep referenced from the Rhino model> x12])
srf = Surface(<surface referenced from the Rhino model>)
mjoin = MeshJoin(Meshes=mesh)
gen_grid = Gen_grid(S=srf, U="60", V="40")
elevate_pts = Elevate_pts(G=gen_grid, F=level)
cluster = Cluster(D=Slider(204, range=0..360))
vec = Vector(cluster)
pt_grid = Point(elevate_pts)
points_outside_brep = PointsOutsideBrep(B=brep, P=pt_grid)
pt = Point(points_outside_brep)
crv = Curve(<curve referenced from the Rhino model>)
divide = DivideCurve(Curve=crv, Count=30, Kinks=False)  # -> Points, Tangents, Parameters
limits = Slider(60, range=0..100)
pt_grid_2 = Point(pt)
vec_2 = Vector(vec)
pt_grid_3 = Point(pt)
mesh_2 = Mesh(mjoin)
pt_grid_4 = Point(pt)
mesh_3 = Mesh(mjoin)
pts_closest_mesh = Pts_closest_mesh(pt_grid=pt_grid_4, M=mesh_3, bool=Toggle(True))  # -> pt_grid_3, S, E, D
timer = Timer(TimerInterval=10000, Target=pyparticle)
python = GhPythonScript(ipt=pt_grid_3, imesh=mesh_2, ivect=vec_2, amp=Slider(5, range=0..50), ray_amp=Slider(105.619, range=0..200))  # -> out, O_DIST, O_PT, O_DEFLECT, O_VECT, O_PS, O_NG; inputs ipt: Point3d, imesh: Mesh, ivect: Vector3d
# ---------- python: Python ----------
__author__ = "seah"
import Rhino
from Rhino.Geometry import Point3d, Vector3d
import rhinoscriptsyntax as rs

thresh=500
left=rs.VectorCrossProduct(ivect,(0,0,1))
right=-left
odeflect=None
opossitive=[]
onegative=[]

def getDistPts(ipt,ivect,imesh,recursive=True):
    deflect=None
    p2=rs.VectorAdd(ipt,rs.VectorScale(ivect,ray_amp))
    dist=ray_amp
    ray=Rhino.Geometry.Ray3d(ipt,ivect)
    t=Rhino.Geometry.Intersect.Intersection.MeshRay(imesh,ray)
    if t>=0:
        ptx=ray.PointAt(t)
        print(ptx)
        p2=ptx
        dist=rs.Distance(ipt,p2)
    if dist>thresh:
        dist=thresh
        
    #recursive to analyize deflection direction
    if recursive:
        ript=ipt+(right*0.01)
        rdist,rp2,temp=getDistPts(ript,ivect,imesh,False)
        if rdist>dist:
            deflect=right
        else:
            deflect=left
    if recursive:
        return (dist*dist/500),p2,deflect
    else:
        return dist,p2,deflect
    
possitive,p2,p_deflect=getDistPts(ipt,ivect,imesh)
negative,p3,n_deflect=getDistPts(ipt,-ivect,imesh)

if possitive is not None and possitive<negative:
    sign=1
    if False:
    #if n_deflect is not None:
        deflect=p_deflect+n_deflect
    else: 
        deflect=p_deflect
    dist=possitive
    opossitive.append(ipt)
elif negative is None or negative<possitive:
    sign=-1
    deflect=-n_deflect
    dist=negative
    onegative.append(ipt)
else:
    sign=0
    deflect=Vector3d(0,0,0)
    dist=0

factor=dist if dist>=1 else 1
factor*=1.3
deflect/=factor
deflect=deflect if rs.VectorLength(deflect)<1 else rs.VectorUnitize(deflect)

ovect=(ivect+deflect)*amp
#ovect=(ivect*amp)

dist=possitive-negative

O_PT=p2
O_DIST=dist
O_DEFLECT=p_deflect
O_VECT=ovect

O_PS=opossitive
O_NG=onegative
# ---------- end python ----------
vec_3 = Vector(python.O_VECT)
pyparticle = GhPythonScript(ipts=flatten(divide.Points), run=Toggle(False), field_pts=flatten(pt_grid_2), field_vects=flatten(vec_3), interval=10)  # -> out, O_P, O_TRAIL, O_SEGMENTS, O_VECTS, O_SPLINE, OPOLY; inputs ipts: list of Point3d, field_pts: list of Point3d, field_vects: list of Vector3d
# ---------- pyparticle: Python ----------
__author__ = "seah"

from Rhino.Geometry import Line, LineCurve, Point3d, Vector3d
import rhinoscriptsyntax as rs

def repel(ip,pts):
    for p in pts:
        dist=rs.Distance(ip,p)
        
    
    

def points_closest_point(p,pts):
    cp=pts[0]
    cd=rs.Distance(p,cp)
    ci=0
    for i in range(len(pts)):
        tp=pts[i]
        d=rs.Distance(p,tp)
        if d<cd:
            cd=d
            cp=tp
            ci=i
    return cp,cd,ci



if run:
    for i in range(len(opts)):
        op=opts[i]
        last_pt=last_pts[i]
        
        cp,cd,ci=points_closest_point(op,field_pts)
        if cd<30:
            #difvect=field_vects[ci]-last_vects[i]
            #vect=last_vects[i]+(difvect)
            vect=field_vects[ci]
            op+=(vect/5)
            display_vect=rs.VectorSubtract(op,last_pt)
            ovects.append(display_vect)
            opts[i]=op
            otrail.append(op)
        
        if rs.Distance(op,last_pt)>1 and step%interval==0:
            ls=last_pt
            le=op
            lc=LineCurve(ls,le)
            last_pts[i]=op
            osegments.append(lc)
        
    
    O_VECTS=ovects
    O_P=opts
    O_TRAIL=otrail
    O_SEGMENTS=osegments
    
else:
    opts=[]
    ovects=[]
    last_pts=[]
    last_vects=[]
    
    for ipt in ipts:
        opts.append(ipt)
        last_pts.append(ipt)
    for vect in field_vects:
        last_vects.append(vect)
    step=0
    osegments=[]
    otrail=[]
# ---------- end pyparticle ----------
python_2 = PythonScript(x=pts_closest_mesh.D, xlim="30", y=python.O_DIST, ylim=limits)  # -> out, O_SCORE
# ---------- python_2: Python ----------
def cap(num,lim):
    if num>lim:
        num=lim
    if num<-lim:
        num=-lim
    return num

def unit(num,lim):
    return num/lim
    

y=unit(cap(y,xlim),xlim)
if x<xlim:
    if y>0:
        sign=1
        x=(1-unit(x,xlim))*0.6
        y*=1
    else:
        sign=-1
        x=(1-unit(x,xlim))*-1

    
else:
    x=0
x*=1
y*=0.8
O_SCORE=x+y
# ---------- end python_2 ----------
divide_2 = DivideCurve(Curve=pyparticle.O_TRAIL, Count=10, Kinks=False)  # -> Points, Tangents, Parameters
bnd = Bounds(Numbers=python_2.O_SCORE)
gradient = Gradient(
    LowerLimit=pts_closest_mesh.S,
    UpperLimit="30",
    Parameter=pts_closest_mesh.D,
    stops=[0: RGB(234, 38, 0), 0.242: RGB(234, 126, 0), 0.489: RGB(254, 244, 84), 0.698: RGB(173, 203, 249), 1: RGB(75, 107, 169)])
gradient_2 = Gradient(
    LowerLimit=-2,
    UpperLimit=2,
    Parameter=python_2.O_SCORE,
    stops=[0: RGB(234, 38, 0), 0.242: RGB(234, 126, 0), 0.489: RGB(255, 255, 255), 0.698: RGB(173, 203, 249), 1: RGB(75, 107, 169)])
panel = Panel(pyparticle.out)
gradient_3 = Gradient(
    LowerLimit=expr("-x", limits),
    UpperLimit=limits,
    Parameter=python.O_DIST,
    stops=[0: RGB(234, 38, 0), 0.25: RGB(234, 126, 0), 0.5: RGB(254, 244, 84), 0.75: RGB(173, 203, 249), 1: RGB(75, 107, 169)])
col = Colour(RGB(13, 182, 255))
crv_2 = Curve(pyparticle.O_SEGMENTS)
pt_2 = Point(pyparticle.O_P)
bnd_2 = Bounds(Numbers=python.O_DIST)
pt_3 = Point(python.O_PS)
pt_4 = Point(python.O_NG)
preview = CustomPreview(Geometry=crv_2, Shader=col)
preview_2 = CustomPreview(Geometry=pts_closest_mesh.pt_grid_3, Shader=gradient)
vdisex = VectorDisplayEx(Point=pyparticle.O_P, Vector=pyparticle.O_VECTS, Colour=col, Width=4)
preview_3 = CustomPreview(Geometry=pt_grid_3, Shader=gradient_2)
vdisex_2 = VectorDisplayEx(Vector=python.O_VECT, Colour=gradient_3, Width=2)
col_2 = Colour(gradient_2)

# ---- group: animate_vectors
disp_amp = Slider(15, range=0..30)
display_path = DisplayPath(V=python.O_VECT, G=pt_grid_3, A=disp_amp)  # -> G_3, L, G_2
timer_2 = Timer(TimerInterval=100, Target=cluster_2)
cluster_2 = Cluster_2(V=display_path.G_2, C=display_path.L, run=Toggle(True))
amp = Amplitude(Vector=python.O_VECT, Amplitude=5)
vdisex_3 = VectorDisplayEx(Point=cluster_2, Vector=amp, Colour=col_2, Width=2)

# ----
pt_5 = Point()

# ==== cluster Gen_grid
S = ClusterInput()
U = ClusterInput()
V = ClusterInput()
mesh_uv = MeshSurface(Surface=S, UCount=U, VCount=V, Overhang=True, Equalize=False)
demesh = DeconstructMesh(Mesh=mesh_uv)  # -> Vertices, Faces, Colours, Normals
V_2 = ClusterOutput(demesh.Vertices)

# ==== cluster Pts_closest_mesh
pt_grid = ClusterInput()
pt_grid_2 = Point(pt_grid)
toggle = BooleanToggle(False)
M = ClusterInput()
bool = ClusterInput()
meshcp = MeshClosestPoint(Point=graft(pt_grid_2), Mesh=M)  # -> Point, Index, Parameter
bool_2 = Boolean(bool)
dist = Distance(PointA=flatten(pt_grid_2), PointB=flatten(meshcp.Point))
eval = Evaluate(F="x>0.001", x=flatten(dist))
bnd = Bounds(Numbers=dist)
dedomain = DeconstructDomain(Domain=bnd)  # -> Start, End
pt_grid_3 = ClusterOutput(pt_grid_2)
E = ClusterOutput(dedomain.End)
S = ClusterOutput(dedomain.Start)
D = ClusterOutput(dist)

# ==== cluster Elevate_pts
F = ClusterInput()
Z = UnitZ(Factor=F)
G = ClusterInput()
move = Move(Geometry=G, Motion=Z)  # -> Geometry, Transform
G_2 = ClusterOutput(move.Geometry)

# ==== cluster Cluster
D = ClusterInput()
Y = UnitY(Factor=1)
rad = Radians(Degrees=D)
rotate = Rotate(Geometry=Y, Angle=rad, Plane=PlaneXY(0, 0, 0))  # -> Geometry, Transform
G = ClusterOutput(rotate.Geometry)

# ==== cluster PointsOutsideBrep
B = ClusterInput()
P = ClusterInput()
brepsinc = PointInBreps(Brep=B, Point=P, Strict=False)  # -> Inside, Index
dispatch = Dispatch(List=P, DispatchPattern=brepsinc.Inside)  # -> ListA, ListB
B_2 = ClusterOutput(dispatch.ListB)

# ==== cluster DisplayPath
G = ClusterInput()
V = ClusterInput()
A = ClusterInput()
amp = Amplitude(Vector=expr("-x", V), Amplitude=expr("x/2", A))
move = Move(Geometry=G, Motion=amp)  # -> Geometry, Transform
move_2 = Move(Geometry=move.Geometry, Motion=V)  # -> Geometry, Transform
G_2 = ClusterOutput(move.Geometry)
G_3 = ClusterOutput(move_2.Geometry)
ln = Line(StartPoint=move.Geometry, EndPoint=move_2.Geometry)
L = ClusterOutput(ln)

# ==== cluster Cluster_2
run = ClusterInput()
python = GhPythonScript(run=run)  # -> out, O_T1, O_AMP1, O_T2, O_AMP2; inputs run: Boolean
# ---------- python: Python ----------
__author__ = "seah"

import rhinoscriptsyntax as rs
step=0.1
amp=0.5

def iter(num):
    num+=step
    if num>1:
        num=0
    return num
    
def get_amp(t1,t2):
    if t2-t1>0.5:
        return 0.5
    else: 
        return (t2-t1)


if run :
    t1=iter(t1)
    amp1=get_amp(t1,1)
    t2=iter(t2)
    amp2=get_amp(t2,1)
    
    O_T1=t1
    O_AMP1=amp1
    O_T2=t2
    O_AMP2=amp2
    
else:
    t1=0.0
    t2=0.5
# ---------- end python ----------
timer = Timer(TimerInterval=100)
V = ClusterInput()
C = ClusterInput()
amp = Amplitude(Vector=V, Amplitude=python.O_AMP1)
eval = EvaluateCurve(Curve=C, Parameter=python.O_T1)  # -> Point, Tangent, Angle
P = ClusterOutput(eval.Point)
